# Grasshopper definition a2-gh-model-wip.gh (Grasshopper 1.0.7)

point = Point(<point referenced from the Rhino model>)
polygon = Polygon(Plane=point, Radius=Slider(24, range=0..100), Segments=Slider(8, range=0..10), FilletRadius=0)  # -> Polygon, Length
deconstruct_brep = DeconstructBrep(Brep=polygon.Polygon)  # -> Faces, Edges, Vertices
length = Length(Curve=deconstruct_brep.Edges)
addition = Addition(A=Slider(7.9, range=0..10), B=Slider(1, range=0..1))
division = Division(A=Slider(3.47, range=0..5), B=length)
curve_middle = CurveMiddle(Curve=deconstruct_brep.Edges)
boolean_toggle = BooleanToggle(True)
curve = Curve(deconstruct_brep.Edges)
scale = Scale(Geometry=curve, Center=curve_middle, Factor=division)  # -> Geometry, Transform
vector_2pt = Vector2Pt(PointA=point, PointB=curve_middle, Unitize=boolean_toggle)  # -> Vector, Length
vector_2pt_2 = Vector2Pt(PointA=curve_middle, PointB=point, Unitize=boolean_toggle)  # -> Vector, Length
amplitude = Amplitude(Vector=vector_2pt_2.Vector, Amplitude=addition)
extrude = Extrude(Base=scale.Geometry, Direction=amplitude)
move = Move(Geometry=extrude, Motion=vector_2pt.Vector)  # -> Geometry, Transform
trim_with_regions = TrimWithRegions(Curve=deconstruct_brep.Faces, Regions=move.Geometry)  # -> Inside, Outside
trim_with_regions_2 = TrimWithRegions(Curve=move.Geometry, Regions=deconstruct_brep.Faces)  # -> Inside, Outside
curve_2 = Curve(flatten(trim_with_regions.Outside))
curve_3 = Curve(flatten(trim_with_regions_2.Inside))
join_curves = JoinCurves(Curves=[curve_3, curve_2], Preserve=False)
panel = Panel(join_curves)
